# Grasshopper definition complete_osm.gh (Grasshopper 1.0.7)
# plug-ins: Urbano

# ----
# longitude
# latitude
# latitude
panel = Panel("-76.4987")
# longitude
panel_2 = Panel("-76.4588")
# Download OSM data based on
# bounding box (can also use OSM file
# downloaded manually)
panel_3 = Panel("42.4552")
pt = ConstructPoint(XCoordinate=panel, YCoordinate="42.4356", ZCoordinate=0)
pt_2 = ConstructPoint(XCoordinate=panel_2, YCoordinate=panel_3, ZCoordinate=0)
path = FilePath("C:\Users\Nikhil Saraf\Desktop\x.osm")
toggle = BooleanToggle(True)
downloadosm = DownloadOpenStreetMapData(BottomLeftCorner=pt, TopRightCorner=pt_2, FilePath=path, RunToggle=Toggle(False))  # -> FilePath, Status
pt_3 = Point(pt)

# ----
# STREETS
importosm = ImportOpenStreetMap(OsmFilePath=downloadosm.FilePath, Type=1, Format=0, BottomLeftCorner=pt_3, RunToggle=toggle)  # -> Points, Keys, Values
# BUILDINGS
importosm_2 = ImportOpenStreetMap(OsmFilePath=downloadosm.FilePath, Type=0, Format=0, BottomLeftCorner=pt_3, RunToggle=toggle)  # -> Points, Keys, Values
# AMENITIES
importosm_3 = ImportOpenStreetMap(OsmFilePath=downloadosm.FilePath, Type=2, Format=0, BottomLeftCorner=pt_3, RunToggle=toggle)  # -> Points, Keys, Values
meta = Metadata(Keys=importosm_3.Keys, Values=importosm_3.Values)  # -> flatten(Metadata)
meta_2 = Metadata(Keys=importosm.Keys, Values=importosm.Values)  # -> flatten(Metadata)
# Build metadata dictionary
meta_3 = Metadata(Keys=importosm_2.Keys, Values=importosm_2.Values)  # -> flatten(Metadata)
pline = PolyLine(Vertices=importosm.Points, Closed=False)  # -> flatten(Polyline)
# Form polylines
# (for buildings and streets)
pline_2 = PolyLine(Vertices=importosm_2.Points, Closed=False)  # -> flatten(Polyline)
# Tolerance for placing amenities
# in buildings (in meters)
number_slider = Slider(10, range=0..10010)
amen = BuildAmenity(Location=flatten(importosm_3.Points), Metadata=meta)
street = CreateStreetSegment(Curve=pline, Metadata=meta_2, Key="name")
# Bake street curves to Rhino
# using button
bake = Button()
# Embed amenities into buildings
# that they are located in
placeamen = PlaceAmenities(Amenities=amen, Buildings=pline_2, Tolerance=number_slider)  # -> Buildings, UnappliedAmenities
bake_2 = UrbanoBake(Curves=street, LayerName="streets", Bake=bake)
bldg = CreateBuilding(Curve=placeamen.Buildings, Metadata=meta_3)
# Bake building curves to Rhino
# using button
bake_3 = Button()
bake_4 = UrbanoBake(Curves=bldg, LayerName="buildings", Bake=bake_3)
