# Grasshopper definition features.gh (Grasshopper 1.0.7)
# plug-ins: Urbano

crv = Curve(<curve referenced from the Rhino model>)
crv_2 = Curve(<curve referenced from the Rhino model>)
crv_3 = Curve(<curve referenced from the Rhino model>)
pt = Point([<point referenced from the Rhino model> x6])
pt_2 = Point([<point referenced from the Rhino model> x4])
pt_3 = Point([<point referenced from the Rhino model> x5])
flatten = FlattenTree(Tree=pt, Path="{0}")
merge = Merge(Data1=crv, Data2=crv_2, Data3=crv_3)
flatten_2 = FlattenTree(Tree=pt_2, Path="{1}")
flatten_3 = FlattenTree(Tree=pt_3, Path="{2}")
# Build a street network out of the
# street curves, (creates a routing and
# distance matrix, splits streets at intersections)
pipeline = GeometryPipeline(
    GroupByLayer=False,
    GroupByType=False,
    IncludeHidden=True,
    IncludeLocked=True,
    LayerFilter="streets",
    NameFilter="*",
    SublayerFiltering=True,
    TypeFilter=4)
pipeline_2 = GeometryPipeline(
    GroupByLayer=False,
    GroupByType=False,
    IncludeHidden=True,
    IncludeLocked=True,
    LayerFilter="streets",
    NameFilter="*",
    SublayerFiltering=True,
    TypeFilter=4)
build = BooleanToggle(True)
pipeline_3 = GeometryPipeline(
    GroupByLayer=False,
    GroupByType=False,
    IncludeHidden=True,
    IncludeLocked=True,
    LayerFilter="buildings",
    NameFilter="*",
    SublayerFiltering=True,
    TypeFilter=4)
toggle = BooleanToggle(True)
transnet = TransitNetwork(
    TransitLine=merge,
    Stations=[flatten, flatten_2, flatten_3],
    settings="{\"SpeedInKmHr\":27.0,\"Speed\":450.0,\"LineTransferTime\":3.0,\"StationStopTime\":1.0}")
network = Network(
    StreetSegments=pipeline,
    BuildToggle=build,
    settings="{\"WalkSpeedInKmhr\":5.0,\"WalkSpeed\":83.333333333333329,\"VertexMergeTolerance\":5.0,\"StreetIntersectionTolerance\":2.5,\"ConnectionMaxDistance\":250.0}")  # -> Network, Streets
pipeline_4 = GeometryPipeline(
    GroupByLayer=False,
    GroupByType=False,
    IncludeHidden=True,
    IncludeLocked=True,
    LayerFilter="buildings",
    NameFilter="*",
    SublayerFiltering=True,
    TypeFilter=4)
network_2 = Network(
    StreetSegments=pipeline_2,
    TransitNetworks=transnet,
    BuildToggle=toggle,
    settings="{\"WalkSpeedInKmhr\":5.0,\"WalkSpeed\":83.333333333333329,\"VertexMergeTolerance\":5.0,\"StreetIntersectionTolerance\":2.5,\"ConnectionMaxDistance\":250.0}")  # -> Network, Streets
# Build a model with buildings and the
# street network (population assigned to
# buildings, amenities tabled)
model = UrbanoModel(Buildings=pipeline_3, Network=network.Network, BuildToggle=build)  # -> UrbanoModel, Activities
model_2 = UrbanoModel(Buildings=pipeline_4, Network=network_2.Network, BuildToggle=toggle)  # -> UrbanoModel, Activities
crv_4 = Curve(<curve referenced from the Rhino model>)
crv_5 = Curve(<curve referenced from the Rhino model>)
router = Router(Network=model_2.UrbanoModel, Origin=crv_4, Destination=crv_5)  # -> Trip, Path, Duration

# ----
# Find all amenities of a certain activity
panel = Panel("bus_stop")  # disabled

# ----
# Find shortest route between
# any two buildings within the model
crv_6 = Curve(<curve referenced from the Rhino model>)  # disabled
crv_7 = Curve(<curve referenced from the Rhino model>)  # disabled

router_2 = Router(Network=model.UrbanoModel, Origin=crv_6, Destination=crv_7)  # -> Trip, Path, Duration; disabled
findamen = FindAmenities(UrbanoModel=model.UrbanoModel, Activity=panel)  # disabled
inamen = InspectAmenity(Amenity=findamen)  # -> Name, Activities, Host; disabled

# ----
# Number of people who used each street
# (Street hits) in these trips
# Number of people who visited each
# amenity (Amenity hits) in these trips
# Persona distribution-weighted
# average walk score
# List of trips is
# branched by persona
# Personas represent the activities
# people need to do within the
# duration of the simulations
# Get the different properties of the trips
# (people, amenity, path, score, cost, etc.)
# Population distribution
# Distribution of specific personas
# (by index) [Should add to 1]
# Ideally, should be run with all buildings input to WalkScore component to get
# an aggregrate walkscore for the entire model (can then weigh the score by the
# population of every building)
# Then use other plugins (like Human) to visualize this data by showing colors
# and extrusions on the 2D geometry (curves for streets,
# footprints for buildings, locations of amenities)
panel_2 = Panel("""restaurant
bank
place_of_worship
bar""")
panel_3 = Panel("""cafe
cafe
school
library
cinema""")
persona = Persona(Activites=simplify(panel_3))
persona_2 = Persona(Activites=panel_2)
panel_4 = Panel("""0.75
0.25""")
merge_2 = Merge(Data1=persona, Data2=persona_2)
model_3 = UrbanoModel(model.UrbanoModel)
population = Population(Personas=merge_2, Distribution=panel_4)
crv_8 = Curve([<curve referenced from the Rhino model> x5])
acttrips = ActivityTripEngine(UrbanoModel=model_3, Building=crv_8, Population=population)  # -> Trips, Distribution
walkscore = WalkScore(UrbanoModel=model_3, Trips=acttrips.Trips)
intrip = InspectTrip(Trip=flatten(acttrips.Trips))  # -> Origin, Destination, Path, Cost, Activity, Amenity, People
hits = StreetAmenityHits(UrbanoModel=model_3, ActivityTrips=flatten(acttrips.Trips))  # -> StreetCurves, StreetHits, Amenity, AmenityHits

trim = TrimTree(Tree=walkscore, Depth=1)

wav = WeightedAverage(Input=trim, Weights=acttrips.Distribution)
panel_5 = Panel(wav)

# ----
# Get the metadata about a
# specific street (by curve), including
# the buildings that connect to it
crv_9 = Curve(<curve referenced from the Rhino model>)  # disabled
panel_6 = Panel("id")  # disabled

insseg = InspectStreetSegment(UrbanoModel=model.UrbanoModel, Street=crv_9)  # -> Geometry, Metadata, AdjacentBuildings; disabled

lookup = LookupMetadata(Metadata=insseg.Metadata, Search=panel_6)  # disabled

# ----
# Get population (or any other property)
# of every building (or a single building)
# Or find properties about
# specific amenities inside the buildings
pipeline_5 = GeometryPipeline(
    GroupByLayer=False,
    GroupByType=False,
    IncludeHidden=True,
    IncludeLocked=True,
    LayerFilter="buildings",
    NameFilter="*",
    SublayerFiltering=True,
    TypeFilter=4)  # disabled
panel_7 = Panel("population")  # disabled

inbldg = InspectBuilding(UrbanoModel=model.UrbanoModel, Building=pipeline_5)  # -> Geometry, Metadata, Amenity; disabled

lookup_2 = LookupMetadata(Metadata=inbldg.Metadata, Search=panel_7)  # disabled

inamen_2 = InspectAmenity(Amenity=flatten(inbldg.Amenity))  # -> Name, Activities, Host; disabled

# ----
# Find the travel radius for a
# specific building and given time limit
# (15 minutes)
pipeline_6 = GeometryPipeline(
    GroupByLayer=False,
    GroupByType=False,
    IncludeHidden=True,
    IncludeLocked=True,
    LayerFilter="buildings",
    NameFilter="*",
    SublayerFiltering=True,
    TypeFilter=4)  # disabled
crv_10 = Curve(<curve referenced from the Rhino model>)  # disabled
time_limit = Slider(16, range=0..100)  # disabled

router_3 = Router(Network=model.UrbanoModel, Origin=crv_10, Destination=pipeline_6)  # -> TripRoute, Path, Duration; disabled

smaller = SmallerThan(FirstNumber=router_3.Duration, SecondNumber=time_limit)  # -> SmallerThan, OrEqualTo; disabled
dispatch = Dispatch(List=pipeline_6, DispatchPattern=smaller.OrEqualTo)  # -> ListA, ListB; disabled
crv_11 = Curve(dispatch.ListA)  # disabled
