# Grasshopper definition unnamed.gh (Grasshopper 1.0.7)
# plug-ins: Ironbug.Grasshopper

# ---- group: Download OSM
# Download OSM data using bounds
relpath = RelativeFilePath(RelativePath="manhattan_sample_smaller.osm")
toggle = BooleanToggle(True)
panel = Panel("40.72")
panel_2 = Panel("-73.984795")
panel_3 = Panel("40.725097")
panel_4 = Panel("-73.995")

# ----
downloadosm = DownloadOpenStreetMapOSM(LeftBound=panel_4, RightBound=panel_2, TopBound=panel_3, BottomBound=panel, FilePath=relpath, RunToggle=toggle)  # -> OSMFilePath, OSMQueryURL, Status
panel_5 = Panel(downloadosm.Status)
osmstreetnet = ImportOSMStreetNetwork(OSMPath=downloadosm.OSMFilePath)  # -> StreetNetwork, Streets, Metadata, UTMZone, TranslationVector
importosm = ImportOpenStreetMapOSMFeatures(OSMPath=downloadosm.OSMFilePath, OSMFeatureType="street", Format=0, RunToggle=toggle)  # -> Points, Metadata, UTMZone, TranslationVector
osmstreetnet_2 = ImportOSMStreetNetwork(OSMPath=downloadosm.OSMQueryURL)  # -> StreetNetwork, Streets, Metadata, UTMZone, TranslationVector
importosm_2 = ImportOpenStreetMapOSMFeatures(OSMPath=downloadosm.OSMQueryURL, OSMFeatureType="street", Format=0, RunToggle=toggle)  # -> Points, Metadata, UTMZone, TranslationVector
pline = PolyLine(Vertices=importosm.Points, Closed=False)  # -> flatten(Polyline)
pline_2 = PolyLine(Vertices=importosm_2.Points, Closed=False)  # -> flatten(Polyline)
streetnet = CreateStreetNetwork(Curves=pline_2, UTMZone=importosm_2.UTMZone, TranslationVector=importosm_2.TranslationVector)  # -> StreetNetwork, StreetSegmentCurves
streetnet_2 = CreateStreetNetwork(Curves=pline, UTMZone=importosm.UTMZone, TranslationVector=importosm.TranslationVector)  # -> StreetNetwork, StreetSegmentCurves
